# Grasshopper definition visualise_in_3d.gh (Grasshopper 1.0.7)

pt = Point(Point(0, 0, 0))
path = FilePath("/Volumes/RED T7 MYK/Dissertation Lidar/vis3d/raster_for_gh.csv")
number_slider = Slider(10, range=0..10)
python = PythonScript(File=path)  # -> Points
# ---------- python: Python ----------
import rhinoscriptsyntax as rs

Points = []

# Open file for reading
file = open(File, 'r')

# Read lines into variable called lines
lines = file.readlines()

# Close file
file.close()

for line in lines:
    # Remove \n
    line = line.strip("\n")
    
    # Split line with comma: creates individual lists of strings
    csvInfo = line.split(',')
    
    # Construct point, cast a float
    pt = rs.AddPoint(float(csvInfo[0]), float(csvInfo[1]), float(csvInfo[2]))
    
    # Append empty list
    Points.append(pt)
# ---------- end python ----------
pt_2 = Point(Point(0, 0, 1.061306574))
pt_3 = Point(python)  # disabled
box = CenterBox(Base=pt_2, X=number_slider, Y=number_slider, Z=number_slider)
del = DelaunayMesh(Points=pt_3, Plane=PlaneXY(0, 0, 0))  # disabled
panel = Panel(del)  # disabled
